# Grasshopper definition 230227_demonstrator_app_test_c.gh (Grasshopper 1.0.7)
# plug-ins: Pufferfish

twist_slider = Slider(205, range=0..360)
# GUI INTERFACE
panel = Panel("Twist [deg.]")
width_slider = Slider(0.5, range=0.1..1)
depth_slider = Slider(0.5, range=0.1..1)
height_slider = Slider(0.5, range=0.1..1)
pv_slider = Slider(0.5, range=0.1..1)
panel_2 = Panel("width [%]")
panel_3 = Panel("PV coverage [%]")
panel_4 = Panel("depth [%]")
panel_5 = Panel("height [%]")
width = GetNumber(width_slider, AtLeast=1, AtMost=2147483647, Maximum=1.797693135e+308, Minimum=-1.797693135e+308, TreeAccess=False)
twist = GetNumber(twist_slider, AtLeast=1, AtMost=2147483647, Maximum=1.797693135e+308, Minimum=-1.797693135e+308, TreeAccess=False)
depth = GetNumber(depth_slider, AtLeast=1, AtMost=2147483647, Maximum=1.797693135e+308, Minimum=-1.797693135e+308, TreeAccess=False)
panel_6 = Panel("""False
False
True""")
height = GetNumber(height_slider, AtLeast=1, AtMost=2147483647, Maximum=1.797693135e+308, Minimum=-1.797693135e+308, TreeAccess=False)
pv_coverage = GetNumber(pv_slider, AtLeast=1, AtMost=2147483647, Maximum=1.797693135e+308, Minimum=-1.797693135e+308, TreeAccess=False)
panel_7 = Panel("""0
1
2""")
number = Number(graft(width))
number_2 = Number(graft(depth))
number_3 = Number(graft(height))
number_4 = Number(flatten(pv_coverage))
panel_8 = Panel(number)
dispatch = Dispatch(List=panel_7, DispatchPattern=panel_6)  # -> ListA, ListB
c_script = CSharpScript(x=number_4)  # -> out, A; inputs x: Double
# ---------- c_script: C# ----------
    if(x == 0)
      A = 0.01;

    else if (x == 1)
      A = 0.999;
    
    else 
      A = x;
# ---------- end c_script ----------
number_5 = Number(number)
number_6 = Number(number_2)
number_7 = Number(number_3)

# ---- group: ORIGIN POINT
# building form
point = Point(Point(0, 0, 0))

# ----
mass_multiplication = MassMultiplication(Input=[number_5, number_6, number_7])  # -> Result, PartialResults
xy_plane = XYPlane(Origin=point)
floor_height = Panel("3")
center_box = CenterBox(Base=xy_plane, X=expr("x/2", number_5), Y=expr("x/2", number_6), Z=expr("x/2", number_7))
desired_max_angle = Panel(Slider(7, range=0..10))
angle_vertical = Slider(1, range=0.2..1)
dom = ConstructDomain(DomainStart=angle_vertical, DomainEnd=1)
panel_9 = Panel("Context BUILDINGS")

# ---- group: LODZ
mesh = Mesh([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])

# ----
c_script_2 = CSharpScript(mesh=mesh)  # -> base64Draco; inputs mesh: Mesh; disabled
# ---------- c_script_2: C# ----------
    var options = new Rhino.FileIO.DracoCompressionOptions();
    options.CompressionLevel = 5;
    options.IncludeTextureCoordinates = false;
    options.IncludeVertexColors = false;

    var compressed = Rhino.FileIO.DracoCompression.Compress(mesh, options);
    base64Draco = compressed.ToBase64String();
# ---------- end c_script_2 ----------
mcol = MeshColours(Mesh=mesh, Colours=ColourSwatch(SwatchColor=RGB(240, 240, 240)))
mjoin = MeshJoin(Meshes=mcol)
panel_10 = Panel("""1
2
3
4""")
mesh_2 = Mesh(mjoin)

target_volume = Panel("10000")

division = Division(A=target_volume, B=mass_multiplication.Result)
cube_root = CubeRoot(Value=division)
scale = Scale(Geometry=center_box, Center=xy_plane, Factor=cube_root)  # -> Geometry, Transform
deconstruct_box = DeconstructBox(Box=scale.Geometry)  # -> Plane, X, Y, Z
volume = Volume(Geometry=scale.Geometry)  # -> Volume, Centroid

real_volume = Panel(volume.Volume)

number_8 = Number(deconstruct_box.X)
number_9 = Number(deconstruct_box.Y)
number_10 = Number(deconstruct_box.Z)
division_2 = Division(A=number_10, B=2)
building_height = Panel(number_10)
vector_xyz = VectorXYZ(XComponent=0, YComponent=0, ZComponent=division_2)  # -> Vector, Length
division_3 = Division(A=building_height, B=floor_height)
move = Move(Geometry=scale.Geometry, Motion=vector_xyz.Vector)  # -> Geometry, Transform
round = Round(Number=division_3)  # -> Nearest, Floor, Ceiling
subtraction = Subtraction(A=round.Nearest)
division_4 = Division(A=twist, B=subtraction)
series = Series(Start=0, Step=division_4, Count=subtraction)
list_item = ListItem(List=series, Index=0, Wrap=True)
list_item_2 = ListItem(List=series, Index=1, Wrap=True)
subtraction_2 = Subtraction(A=list_item_2, B=list_item)
panel_11 = Panel(subtraction_2)
larger_than = LargerThan(FirstNumber=panel_11, SecondNumber=desired_max_angle)  # -> LargerThan, OrEqualTo
deconstruct_brep = DeconstructBrep(Brep=move.Geometry)  # -> Faces, Edges, Vertices
panel_12 = Panel(round.Nearest)
division_5 = Division(A=building_height, B=round.Nearest)
base = ListItem(List=deconstruct_brep.Faces, Index=Slider(4, range=0..6), Wrap=True)
addition = Addition(A=panel_12, B="-1")
c_script_3 = CSharpScript(x=larger_than.LargerThan, y=panel_11, z=addition, u=desired_max_angle)  # -> out, A; inputs x: Boolean, y: Double, z: Double, u: Double
# ---------- c_script_3: C# ----------
    if (x == true)
      A = (y / u) * z;
    else A = z;
# ---------- end c_script_3 ----------
round_2 = Round(Number=c_script_3.A)  # -> Nearest, Floor, Ceiling
division_6 = Division(A=addition, B=round_2.Nearest)
series_2 = Series(Start=0, Step=division_5, Count=round_2.Nearest)
list_length = ListLength(List=series_2)
flip = Flip(Surface=base)  # -> Surface, Result
subtraction_3 = Subtraction(A=list_length, B=1)
list_item_3 = ListItem(List=series_2, Index=subtraction_3, Wrap=True)
panel_13 = Panel(list_item_3)
vector_xyz_2 = VectorXYZ(XComponent=0, YComponent=0, ZComponent=panel_13)  # -> Vector, Length
extrude = Extrude(Base=flip.Surface, Direction=vector_xyz_2.Vector)
scale_to_volume = ScaleToVolume(Geometry=extrude, Plane=PlaneXY(0, 0, 0), Volume="10000", FactorX=division_6, FactorY=division_6, FactorZ="1")  # -> Scaled, Transform
deconstruct_box_2 = DeconstructBox(Box=scale_to_volume.Scaled)  # -> Plane, X, Y, Z
subtraction_4 = Subtraction(A=round_2.Nearest)
number_11 = Number(deconstruct_box_2.Z)
subtraction_5 = Subtraction(A=subtraction_4, B=1)
division_7 = Division(A=twist, B=subtraction_4)
division_8 = Division(A=number_11, B=floor_height)
series_3 = Series(Start=0, Step=division_7, Count=subtraction_4)
range = Range(Domain=dom, Steps=subtraction_5)
round_3 = Round(Number=division_8)  # -> Nearest, Floor, Ceiling
reverse_list = ReverseList(List=range)
deconstruct_brep_2 = DeconstructBrep(Brep=scale_to_volume.Scaled)  # -> Faces, Edges, Vertices
division_9 = Division(A=number_11, B=round_3.Nearest)

# ---- group: floor
floors = ListItem(List=deconstruct_brep_2.Faces, Index=Slider(0, range=0..6), Wrap=True)  # -> simplify(flatten(Item))

# ----
series_4 = Series(Start=0, Step=division_9, Count=round_2.Nearest)
flip_2 = Flip(Surface=floors)  # -> Surface, Result
offsrf = OffsetSurface(Surface=flip_2.Surface, Distance=series_4, BothSides=0, CreateSolid=False)  # -> flatten(Offset)
area = Area(Geometry=offsrf)  # -> Area, Centroid
scale_2 = Scale(Geometry=offsrf, Center=area.Centroid, Factor=reverse_list)  # -> Geometry, Transform
vector_xyz_3 = VectorXYZ(XComponent=0, YComponent=0, ZComponent=division_9)  # -> Vector, Length
rotate = Rotate(Geometry=scale_2.Geometry, Angle=degrees(series_3), Plane=area.Centroid)  # -> Geometry, Transform
extrude_2 = Extrude(Base=rotate.Geometry, Direction=vector_xyz_3.Vector)
deconstruct_brep_3 = DeconstructBrep(Brep=extrude_2)  # -> Faces, Edges, Vertices
floors_2 = ListItem(List=deconstruct_brep_3.Faces, Index=Slider(0, range=0..6), Wrap=True)  # -> simplify(flatten(Item))
floors_3 = ListItem(List=floors_2, Index=Slider(0, range=0..6), Wrap=True)  # -> simplify(flatten(Item))
stream_filter = StreamFilter(Gate=0, Stream0=floors_2, Stream1=floors_3)

# ---- group: FLOORS
simple_mesh = SimpleMesh(Brep=stream_filter)

# ----
list_length_2 = ListLength(List=extrude_2)
mcol_2 = MeshColours(Mesh=simple_mesh, Colours=ColourSwatch(SwatchColor=RGB(209, 209, 209)))
subtraction_6 = Subtraction(A=list_length_2, B=1)
mjoin_2 = MeshJoin(Meshes=mcol_2)
deconstruct_brep_4 = DeconstructBrep(Brep=extrude_2)  # -> simplify(Faces), Edges, Vertices
list_item_4 = ListItem(List=extrude_2, Index=subtraction_6, Wrap=True)
mesh_3 = Mesh(mjoin_2)
deconstruct_brep_5 = DeconstructBrep(Brep=list_item_4)  # -> Faces, Edges, Vertices

# ---- group: PV ON ROOF
roof = ListItem(List=deconstruct_brep_5.Faces, Index=Slider(5, range=0..6), Wrap=True)  # -> simplify(flatten(Item))
panel_14 = Panel("""0
1""")
rectangle = Rectangle(roof)
parameter_rectangle_grid = ParameterRectangleGrid(Rectangle=rectangle, ParametersX=["0", c_script.A, "1"], ParametersY=panel_14)  # -> flatten(Cells), Points
boundary_surfaces = BoundarySurfaces(Edges=parameter_rectangle_grid.Cells)

# ---- group: PV ON ROOF / PV SURFACE
list_item_5 = ListItem(List=boundary_surfaces, Index=0, Wrap=True)

# ---- group: PV
simple_mesh_2 = SimpleMesh(Brep=list_item_5)

# ----
mcol_3 = MeshColours(Mesh=simple_mesh_2, Colours=ColourSwatch(SwatchColor=RGB(37, 41, 250)))
mjoin_3 = MeshJoin(Meshes=mcol_3)
mesh_4 = Mesh(mjoin_3)
roof_facade = ListItem(List=deconstruct_brep_4.Faces, Index=panel_10, Wrap=True)  # -> simplify(flatten(Item))

# ---- group: FACADE
simple_mesh_3 = SimpleMesh(Brep=roof_facade)

# ----
mcol_4 = MeshColours(Mesh=simple_mesh_3, Colours=ColourSwatch(SwatchColor=RGBA(63, 166, 166, 54)))
mjoin_4 = MeshJoin(Meshes=mcol_4)
mesh_5 = Mesh(mjoin_4)
mjoin_5 = MeshJoin(Meshes=[mesh_5, mesh_4, mesh_3, mesh_2])

# ---- group: RH_OUT:geometry
mesh_6 = Mesh(mjoin_5)

# ----
custom_preview = CustomPreview(
    Geometry=mesh_6,
    Material={diffuse=RGB(46, 139, 87), emission=RGB(66, 48, 66), shine=0.5, specular=RGB(255, 255, 255), transparency=0})
